# Grasshopper definition HilbertCurving.gh (Grasshopper 1.0.7)

crv = Curve(<curve referenced from the Rhino model>)
python = GhPythonScript(
    crvs=crv,
    GLOBAL_SCALE=Slider(6.2, range=1..100),
    max_depth=Slider(7, range=0..10),
    x=Slider(9.42, range=1..10),
    y=Slider(8.6, range=1..10),
    z=Slider(7.86, range=1..10),
    height=Slider(6.81, range=1..10))  # -> out, a; inputs crvs: list of Curve
# ---------- python: Python ----------
import os
import sys

file_name = ghenv.Component.OnPingDocument().FilePath

def get_parent(path, degree = 1):
    
    parent = path
    
    for i in range(degree):
        
        parent = os.path.dirname(parent)
        
    return parent
    
path = get_parent(file_name, 3)

sys.path.append(os.path.join(path, 'src') )

from spacemapping_curve.quadtree import *
import spacemapping_curve.distance as sdf
import spacemapping_curve.hilbertcurve as hc

import Rhino.Geometry as rg
import rhinoscriptsyntax as rs 

reload(hc)
reload(sdf)

# ==============================================================================
# get distance value
# ==============================================================================
sdf.DistanceToCurve.GLOBAL_SCALE = GLOBAL_SCALE
# sdf.FuckYouBernhardFunction.GLOBAL_SCALE = GLOBAL_SCALE

# sdf.SDF.X_SCALE = x
# sdf.SDF.Y_SCALE = y
# sdf.SDF.Z_SCALE = z

# sdf.FuckYouBernhardFunction.HEIGHT = height * z

crv_distance = sdf.DistanceToCurve(crvs)
crv_distance = sdf.Gyroid(x, y, z, height, GLOBAL_SCALE)

# ==============================================================================
# Main
# ==============================================================================

a = hc.draw_hc(200, max_depth, crv_distance)
# ---------- end python ----------
panel = Panel(python.out)
